# Requirement set requirements (R2022a)

## 1 [1] horizontal to destination and not accident
we move horizontal and want to avoid accident in this move

## 2 [2] move vertical to destination and not accident
we want to move vertical and avoid accident

## 3 [3] move horizontal to arrive destination
we will move horizontal to arrive destination

## 4 [4] finish horizontal move
we arrived horizontal move and want to start vertical move to arrive x and y of destination

## 5 [5] move vertical to arrive vertical destination
we want to move vertical to arrive destination

## 6 [6] finish vertical moves
we arrived vertical destination and want to arrive to horizontal destination

## 7 [7] arrive destination
we arrive our destination and finish movement

## 8 [8] finish vertical not arrive destination
we finish vertical move not arrive destination and we add one vertical move

## 9 [9] finish horizontal not arrive destination
we finish horizontal move not arrive destination and we add one horizontal move